test file "BatterySOCSysIntTest"
  description: Test the RMSE value of the Simulink model predictions.

suite "System Integration Tests"

  case "Simulink_TestData_RMSE" [simulation]
    model BatterySOCEstimationDeepLearning, harness SCOEstimator_Harness (for BatterySOCEstimationDeepLearning/SOC Estimator)
    custom criteria:
      predictedSOC = get(test.sltest_simout.yout,"predictedSOC").Values.Data;
      load("BSOCTestingData\BSOC_"+test.sltest_iterationName+"_degrees.mat","Y");

      Y=Y';

      testRMSE = rmse(predictedSOC,Y);

      test.verifyLessThan(testRMSE,0.05,['RMSE: ',num2str(testRMSE),'.'])
    iterations:
      0: SignalBuilderGroup "temp_0"
      10: SignalBuilderGroup "temp_10"
      25: SignalBuilderGroup "temp_25"
      n10: SignalBuilderGroup "temp_n10"